# Grasshopper definition Stepping.gh (Grasshopper 1.0.7)

srf = Surface(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)
c_shifting = CSharpScript(Srf=srf, u=Slider(20, range=0..30), v=Slider(12, range=0..20), t1=Slider(0.9, range=0..1))  # -> out, A; inputs Srf: Surface, u: Int32, v: Int32, t1: Double
# ---------- c_shifting: C# ----------
    List < Curve > IsoU = new List<Curve>();
    DataTree < Curve > IsoV = new DataTree<Curve>();
    DataTree < Surface > Srfs2 = new DataTree<Surface>();



    //unitize surface
    Interval unit = new Interval(0, 1);
    Unitize(Srf);


    //Creating IsoCrvsU
    if(u < 1 && v < 1)throw new Exception("Division count is Zero");else
      for (int i = 0;i < u;i++){
        double d1 = i / (double) u;
        IsoU.Add(Srf.IsoCurve(0, d1));
      }

    List<Surface> nSrf = Slicer(Srf, IsoU);


    //SortingPanels
    List<Surface> SortedUSrf = sortPanels(nSrf, Srf);
    // A = SortedUSrf;



    //CreatingDataTreePaths
    List <GH_Path> paths = new List <GH_Path>();
    for (int i = 0;i < u;i++){
      GH_Path path = new GH_Path(i);
      paths.Add(path);
    }


    //Creating IsoCrvsU
    for (int i = 0;i < u;i++){
      for (int j = 0;j < v;j++){
        double d2 = j / (double) v;
        double d3 = i * t1;
        double d4 = d3 + d2;

        while(d4 > 1 ){
          d4 = (d4 - 1);
        }
        IsoV.Add((SortedUSrf[i].IsoCurve(1, d4)), paths[i]);
      }
    }


    for(int i = 0;i < SortedUSrf.Count; i++){
      List<Surface> nVSrf = Slicer(SortedUSrf[i], IsoV.Branch(i));
      Srfs2.AddRange(nVSrf, paths[i]);
    }
    A = Srfs2;
# ---------- c_shifting: C# additional code ----------
  //unitizer
  public Surface Unitize(Surface nSrf){

    Interval unit = new Interval(0, 1);
    nSrf.SetDomain(0, unit);
    nSrf.SetDomain(1, unit);
    return nSrf;
  }


  public List<Surface> Slicer(Surface Srfs, List<Curve> Isos){

    List < Surface > bFaces = new List<Surface>();
    Brep SrfB = Srfs.ToBrep();
    BrepFace bF = SrfB.Faces[0];
    Brep bFs = bF.Split(Isos, 0.01);

    for (int i = 0; i < bFs.Faces.Count;i++){
      bFs.Faces.ShrinkFaces();
      BrepFace B = bFs.Faces[i];
      B.ToNurbsSurface();
      bFaces.Add(B);
    }

    return bFaces;
  }


  //sorter
  public List<Surface> sortPanels (List<Surface> Bfaces, Surface rapedSrf){
    List<Surface> temps = new List<Surface>();
    List<Surface> temp = Bfaces;
    while(temp.Count > 0){
      Interval unit = new Interval(0, 1);
      double Srfu;
      double Srfv;
      int CurrentInd = -1;
      double CurrentValue = double.MaxValue;
      for (int i = 0;i < temp.Count;i++){
        Unitize(temp[i]);
        Point3d Cen = temp[i].PointAt(0.5, 0.5);
        rapedSrf.ClosestPoint(Cen, out Srfu, out Srfv);
        double Value = (Srfu * 10000) + (Srfv * 100);
        if (Value < CurrentValue){
          CurrentValue = Value;
          CurrentInd = i;
        }
      }

      temps.Add(temp[CurrentInd]);
      temp.RemoveAt(CurrentInd);
    }
    return temps;
  }
# ---------- end c_shifting ----------
data = Data(c_shifting.A)
