# Grasshopper definition Massing Generation and Area Analysis From Floor Plans.gh (Grasshopper 1.0.7)

# ---- group: inputs / Starting Elevation
merge = Merge(Data1=Slider(24, range=0..48), Data2=Slider(0, range=0..15))

# ---- group: Floor To Floor Height
merge_2 = Merge(Data1=Slider(12, range=0..100), Data2=Slider(24, range=0..36))

# ---- group: inputs / Floor Count
merge_3 = Merge(Data1=Slider(6, range=0..10), Data2=Slider(2, range=0..10))

# ---- group: inputs / Plan Boundaries
crv = Curve(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)
# Working with floor boundaries
crv_2 = Curve(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)
merge_4 = Merge(Data1=crv_2, Data2=crv)

# ---- group: Creating And Sorting the Floor Plan Boundaries
floor_to_floor_height = Number(merge_2)
boundaries = Curve(merge_4)
xy = XYPlane(Origin=Point(0, 0, 0))
project = Project(Geometry=boundaries, Plane=xy)  # -> Geometry, Transform
floor_count = Number(merge_3)
series = Series(Start=merge, Step=floor_to_floor_height, Count=floor_count)
Z = UnitZ(Factor=series)
move = Move(Geometry=graft(project.Geometry), Motion=Z)  # -> Geometry, Transform
flatten = FlattenTree(Tree=move.Geometry, Path="{0}")
area = Area(Geometry=flatten)  # -> Area, Centroid
pdecon = Deconstruct(Point=area.Centroid)  # -> XComponent, YComponent, ZComponent
cset = CreateSet(List=pdecon.ZComponent)  # -> Set, Map
sort = SortList(Keys=cset.Set)  # -> Keys, ValuesA
similar = Similarity(FirstNumber=graft(sort.Keys), SecondNumber=pdecon.ZComponent, Threshold=Slider(0.001, range=0..0.001))  # -> Similarity, AbsoluteDifference
cull = CullPattern(List=flatten, CullPattern=similar.Similarity)
runion = RegionUnion(Curves=cull)

# ---- group: Massing
floor_to_floor_height_2 = Number(floor_to_floor_height)
floor_boundaries = Curve(move.Geometry)
Z_2 = UnitZ(Factor=floor_to_floor_height_2)  # -> graft(UnitVector)
extr = Extrude(Base=floor_boundaries, Direction=Z_2)
join = BrepJoin(Breps=flatten(extr))  # -> Breps, Closed
cap = CapHoles(Brep=join.Breps)
sunion = SolidUnion(Breps=cap)
massing_union = Brep(sunion)

# ----
floor_boundaries_2 = Curve(runion)

# ---- group: Floor Areas
area_2 = Area(Geometry=floor_boundaries_2)  # -> Area, Centroid
ma = MassAddition(Input=area_2.Area)  # -> flatten(Result), PartialResults
round = Round(Number=ma.Result)  # -> Nearest, Floor, Ceiling
areas_per_floor = Number(round.Nearest)

# ---- group: Floor Count
lng = ListLength(List=cset.Set)
series_2 = Series(Start="1", Step=1, Count=lng)
floor_count_2 = Integer(series_2)

# ---- group: Elevations
round_2 = Round(Number=sort.Keys)  # -> Nearest, Floor, Ceiling
floor_elevations = Number(round_2.Nearest)

# ---- group: Floor To Floor Heights
floor_elevations_2 = Number(reverse(floor_elevations))
item = ListItem(List=floor_elevations_2, Index=0, Wrap=True)
ins = InsertItems(List=floor_elevations_2, Item=item, Indices="0", Wrap=True)  # -> reverse(List)
shift = ShiftList(List=reverse(ins), Shift=1, Wrap=False)  # -> reverse(List)
shift_2 = ShiftList(List=ins, Shift=1, Wrap=False)
subtraction = Subtraction(A=shift_2, B=shift)
floor_to_floor_heights = Number(subtraction)

# ---- group: Total Floor Area
ma_2 = MassAddition(Input=round.Nearest)  # -> flatten(Result), PartialResults
total_area = Number(ma_2.Result)

# ----
floor_boundaries_3 = Curve(floor_boundaries_2)
bbox = BoundingBox(Content=sunion, Plane=PlaneXY(0, 0, 0), UnionBox=True)  # -> Box, Box_2
debox = DeconstructBox(Box=bbox.Box_2)  # -> Plane, X, Y, Z
floor_to_floor_heights_2 = Number(floor_to_floor_heights)
floor_elevations_3 = Number(floor_elevations)
areas_per_floor_2 = Number(areas_per_floor)
floor_count_3 = Integer(floor_count_2)
total_area_2 = Number(total_area)

# ---- group: Geometry
floor_boundaries_4 = Curve(floor_boundaries_3)
massing_union_2 = Brep(massing_union)

# ----
dedomain = DeconstructDomain(Domain=debox.Z)  # -> Start, End
floor_count_4 = Panel(floor_count_3)
max_building_height = Panel(dedomain.End)
floor_elevations_4 = Panel(floor_elevations_3)
floor_to_floor_heights_3 = Panel(floor_to_floor_heights_2)
total_area_3 = Panel(total_area_2)
areas_per_floor_3 = Panel(areas_per_floor_2)
preview = CustomPreview(Geometry=massing_union_2, Material=ColourSwatch(SwatchColor=RGB(178, 197, 219)))
preview_2 = CustomPreview(Geometry=floor_boundaries_4, Material=ColourSwatch(SwatchColor=RGB(19, 47, 84)))
