# Grasshopper definition facade-morph.gh (Grasshopper 1.0.7)

number_slider = Slider(1000, range=0..1000)
xy = XYPlane(Origin=Point(0, 0, 0))
yz = YZPlane(Origin=Point(0, 0, 0))
srf = Surface(<surface referenced from the Rhino model>)
rectangle = Rectangle(Plane=xy, XSize=number_slider, YSize=number_slider, Radius=0)  # -> Rectangle, Length
divide = DivideDomain²(Domain=srf, UCount=Slider(6, range=0..10), VCount=Slider(15, range=0..25))
boundary = BoundarySurfaces(Edges=rectangle.Rectangle)
subsrf = Isotrim(Surface=srf, Domain=divide)
number_slider_2 = Slider(0.404, range=0..1)
area = Area(Geometry=boundary)  # -> Area, Centroid
sbox = SurfaceBox(Surface=subsrf, Domain=divide, Height=Slider(470.11, range=0..1000))
lng = ListLength(List=sbox)
random = Random(Range=Domain(0.4, 0.55), Number=lng, Seed=2)
scale = Scale(Geometry=boundary, Center=area.Centroid, Factor=random)  # -> Geometry, Transform
number_slider_3 = Slider(300.11, range=0..1000)
Z = UnitZ(Factor=number_slider_3)
repeat = RepeatData(Data=boundary, Length=lng)
move = Move(Geometry=scale.Geometry, Motion=Z)  # -> Geometry, Transform
X = UnitX(Factor=number_slider_3)
merge = Merge(Data1=graft(repeat), Data2=graft(move.Geometry))
loft = Loft(Curves=merge, Options={Adjust=False, Closed=False, LoftEnds=0, LoftSimp=0, LoftType=0, Rebuild=10, Refit=0.01})  # -> flatten(Loft)
bbox = BoundingBox(Content=loft, Plane=PlaneXY(0, 0, 0))  # -> Box, Box_2
morph = BoxMorph(Geometry=loft, Reference=bbox.Box_2, Target=sbox)
