# Grasshopper definition grid-spread-2d.gh (Grasshopper 1.0.4)

recgrid = Rectangular(
    Plane=PlaneXY(0, 0, 0),
    SizeX=Slider(3.45, range=0..10),
    SizeY=Slider(3.45, range=0..10),
    ExtentX=Slider(15, range=0..100),
    ExtentY=Slider(20, range=0..100))  # -> Cells, Points
pt = Point(simplify(recgrid.Points))
flip = FlipMatrix(Data=pt)
merge = Merge(Data1=recgrid.Points, Data2=flip)
pline = PolyLine(Vertices=merge, Closed=False)
bbox = BoundingBox(Content=flatten(pline), Plane=PlaneXY(0, 0, 0), UnionBox=True)  # -> Box, Box_2
pop2d = Populate2D(Region=bbox.Box, Count=Slider(36, range=0..100), Seed=1)
divide = DivideCurve(Curve=pline, Count=Slider(11, range=0..100), Kinks=False)  # -> Points, Tangents, Parameters
cp = ClosestPoint(Point=divide.Points, Cloud=pop2d)  # -> ClosestPoint, CPIndex, Distance
larger = LargerThan(FirstNumber=cp.Distance, SecondNumber=Slider(6.62, range=0..10))  # -> LargerThan, OrEqualTo
dispatch = Dispatch(List=divide.Points, DispatchPattern=larger.LargerThan)  # -> ListA, ListB
pt_2 = Point(dispatch.ListB)
pt_3 = Point(dispatch.ListA)
index = ItemIndex(List=divide.Points, Item=dispatch.ListB)
cp_2 = ClosestPoint(Point=pt_2, Cloud=flatten(pt_3))  # -> ClosestPoint, CPIndex, Distance
replace = ReplaceItems(List=divide.Points, Item=cp_2.ClosestPoint, Indices=index, Wrap=False)
pline_2 = PolyLine(Vertices=replace, Closed=False)
divide_2 = DivideCurve(Curve=pline_2, Count=Slider(7, range=0..10), Kinks=False)  # -> Points, Tangents, Parameters
intcrv = Interpolate(Vertices=divide_2.Points, Degree=3, Periodic=False, KnotStyle=1)  # -> Curve, Length, Domain
