# Grasshopper definition stairs-type 1.gh (Grasshopper 1.0.7)

# ----
# Initial Grid
number_slider = Slider(1200, range=0..10000)
number_slider_2 = Slider(350, range=0..1000)
number_slider_3 = Slider(17, range=0..100)
addition = Addition(A=number_slider_3, B=1)
series = Series(Start=0, Step=Slider(180, range=0..1000), Count=addition)
recgrid = Rectangular(
    Plane=PlaneXY(0, 0, 0),
    SizeX=number_slider,
    SizeY=number_slider_2,
    ExtentX=Slider(1, range=0..10),
    ExtentY=number_slider_3)  # -> Cells, Points
Z = UnitZ(Factor=series)
pt = Point(recgrid.Points)
move = Move(Geometry=pt, Motion=Z)  # -> Geometry, Transform

# ----
# Split Points In Half
lng = ListLength(List=move.Geometry)
division = Division(A=lng, B=2)
split = SplitList(List=move.Geometry, Index=division)  # -> ListA, ListB
# Setting Up The Heights
pt_2 = Point(split.ListA)
pt_3 = Point(split.ListB)

pdecon = Deconstruct(Point=pt_2)  # -> XComponent, YComponent, ZComponent
neg = Negative(Value=Slider(1, range=0..1))
pdecon_2 = Deconstruct(Point=pt_3)  # -> XComponent, YComponent, ZComponent
item = ListItem(List=pt_2, Index=0, Wrap=True)
item_2 = ListItem(List=pt_3, Index=neg, Wrap=True)
pdecon_3 = Deconstruct(Point=item)  # -> XComponent, YComponent, ZComponent
pdecon_4 = Deconstruct(Point=item_2)  # -> XComponent, YComponent, ZComponent
pt_4 = ConstructPoint(XCoordinate=pdecon.XComponent, YCoordinate=pdecon.YComponent, ZCoordinate=pdecon_3.ZComponent)
pt_5 = ConstructPoint(XCoordinate=pdecon_2.XComponent, YCoordinate=pdecon_2.YComponent, ZCoordinate=pdecon_4.ZComponent)
bang = ExplodeTree(Data=pt_4)  # -> _0000, _0010
bang_2 = ExplodeTree(Data=pt_5)  # -> _0000, _0010
pt_6 = Point(bang._0000)
pt_7 = Point(bang_2._0000)

# ----
# Surrounding Points
distance_from_the_stairs = Slider(795, range=0..1000)
rest_surfaces = Slider(1000, range=0..1000)
neg_2 = Negative(Value=distance_from_the_stairs)
neg_3 = Negative(Value=rest_surfaces)
X = UnitX(Factor=neg_2)
X_2 = UnitX(Factor=distance_from_the_stairs)
X_3 = UnitX(Factor=rest_surfaces)
X_4 = UnitX(Factor=neg_3)
pt_8 = Point(bang_2._0010)
pt_9 = Point(bang._0010)
move_2 = Move(Geometry=pt_6, Motion=X)  # -> Geometry, Transform
move_3 = Move(Geometry=pt_9, Motion=X_2)  # -> Geometry, Transform
move_4 = Move(Geometry=pt_7, Motion=X)  # -> Geometry, Transform
move_5 = Move(Geometry=pt_8, Motion=X_2)  # -> Geometry, Transform
move_6 = Move(Geometry=move_4.Geometry, Motion=X_4)  # -> Geometry, Transform
move_7 = Move(Geometry=move_5.Geometry, Motion=X_3)  # -> Geometry, Transform
bang_3 = ExplodeTree(Data=pt_2)  # -> _0000, _0010
bang_4 = ExplodeTree(Data=pt_3)  # -> _0000, _0010
move_8 = Move(Geometry=move_3.Geometry, Motion=X_3)  # -> Geometry, Transform
move_9 = Move(Geometry=move_2.Geometry, Motion=X_4)  # -> Geometry, Transform

# ----
# Data tree paired together
entwine = Entwine(
    Branch00=move_6.Geometry,
    Branch01=move_4.Geometry,
    Branch02=bang_4._0000,
    Branch03=bang_4._0010,
    Branch04=move_5.Geometry,
    Branch05=move_7.Geometry,
    FlattenInputs=True)
entwine_2 = Entwine(
    Branch00=move_9.Geometry,
    Branch01=move_2.Geometry,
    Branch02=bang_3._0000,
    Branch03=bang_3._0010,
    Branch04=move_3.Geometry,
    Branch05=move_8.Geometry,
    FlattenInputs=True)
flip = FlipMatrix(Data=entwine_2)
flip_2 = FlipMatrix(Data=entwine)
number_slider_4 = Slider(50, range=0..50)
pline = PolyLine(Vertices=flip, Closed=False)
pline_2 = PolyLine(Vertices=flip_2, Closed=False)
divide = DivideCurve(Curve=pline, Count=number_slider_4, Kinks=False)  # -> Points, Tangents, Parameters
divide_2 = DivideCurve(Curve=pline_2, Count=number_slider_4, Kinks=False)  # -> Points, Tangents, Parameters
nurbs = NurbsCurve(Vertices=divide.Points, Degree=3, Periodic=False)  # -> Curve, Length, Domain
nurbs_2 = NurbsCurve(Vertices=divide_2.Points, Degree=3, Periodic=False)  # -> Curve, Length, Domain
Y = UnitY(Factor=number_slider_2)
extr = Extrude(Base=nurbs.Curve, Direction=Y)
Y_2 = UnitY(Factor=number_slider_2)
extr_2 = Extrude(Base=nurbs_2.Curve, Direction=Y_2)
Z_2 = UnitZ(Factor=Slider(38, range=0..1000))
extr_3 = Extrude(Base=extr_2, Direction=Z_2)
extr_4 = Extrude(Base=extr, Direction=Z_2)

# ----
# Railings
number_slider_5 = Slider(900, range=0..1000)
line = LineSDL(Start=move.Geometry, Direction=Vector(0, 0, 1), Length=number_slider_5)
Y_3 = UnitY(Factor=Slider(140.87, range=0..350))
move_10 = Move(Geometry=line, Motion=Y_3)  # -> Geometry, Transform
pipe = Pipe(Curve=move_10.Geometry, Radius=Slider(7.65, range=0..100), Caps=0)
