# Grasshopper definition export-geo-csharp.gh (Grasshopper 1.0.7)

geo = Geometry([<curve referenced from the Rhino model> x2])
path = FilePath("C:\Users\Arze\Downloads\2\")
toggle = BooleanToggle(True)
python = GhPythonScript(geo=geo, type="ai")  # -> out, filename; inputs geo: list
# ---------- python: Python ----------
import rhinoscriptsyntax as rs

filename = []

for i,e in enumerate(geo):
    filename.append("curve_{0}.{1}".format(i,type))
# ---------- end python ----------
c_script = CSharpScript(geometries=geo, filename=python.filename, directory=path, export=Button())  # -> out; inputs geometries: list of GeometryBase, filename: list of String, directory: String, export: Boolean
# ---------- c_script: C# usings ----------
using System.IO;
# ---------- c_script: C# ----------
    if (export)
    {
      var guids = new List<Guid>();

      for (int i = 0; i < geometries.Count; i++)
      {
        var geom = geometries[i];
        var guid = RhinoDocument.Objects.Add(geom);
        guids.Add(guid);
        RhinoDocument.Objects.Select(guid);

        // Save to a temporary format (e.g., .svg)
        string tempFilePath = Path.Combine(directory, filename[i]);
        RhinoApp.RunScript("_-Export \"" + tempFilePath + "\" _Enter _Enter", false);

        RhinoDocument.Objects.Delete(guids, true);
      }
    }
# ---------- end c_script ----------
