# Grasshopper definition slider-ui-csharp.gh (Grasshopper 1.0.7)

c_script = CSharpScript(x=Slider(56, range=0..100), y=Slider(56, range=0..100))  # -> out, A; inputs x: Int32, y: Int32
# ---------- c_script: C# ----------
    var input = Component.Params.Input[0].Sources[0]; //get the first thing connected to the first input of this component
    var slider = input as Grasshopper.Kernel.Special.GH_NumberSlider; //try to cast that thing as a slider

    if(slider != null) //if the component was successfully cast as a slider
    {
      slider.SetSliderValue((decimal) y);
    }
# ---------- end c_script ----------
c_script_2 = CSharpScript(x=Slider(18, range=0..78), y=Slider(78, range=0..100))  # -> out, A; inputs x: Int32, y: Int32
# ---------- c_script_2: C# ----------
    var input = Component.Params.Input[0].Sources[0]; //get the first thing connected to the first input of this component
    var slider = input as Grasshopper.Kernel.Special.GH_NumberSlider; //try to cast that thing as a slider

    if(slider != null) //if the component was successfully cast as a slider
    {
      //Color c = Color.FromArgb(255, 255, 0, 0);
      slider.Slider.RailDisplay = Grasshopper.GUI.Base.GH_SliderRailDisplay.Filled;
      slider.Slider.RailFullColour = System.Drawing.Color.FromArgb(y * 2, 255, 0, 0);
      slider.Slider.Minimum = 0;
      slider.Slider.Maximum = y;
    }
# ---------- end c_script_2 ----------
c_script_3 = CSharpScript(x=Slider(9, range=0..44), y=Slider(44, range=0..100))  # -> out, A; inputs x: Int32, y: Int32
# ---------- c_script_3: C# ----------
    var input = Component.Params.Input[0].Sources[0]; //get the first thing connected to the first input of this component
    var slider = input as Grasshopper.Kernel.Special.GH_NumberSlider; //try to cast that thing as a slider

    if(slider != null) //if the component was successfully cast as a slider
    {
      slider.Slider.Minimum = 0;
      slider.Slider.Maximum = y;
    }
# ---------- end c_script_3 ----------
